# Grasshopper definition assignment2.gh (Grasshopper 1.0.7)

width_of_cut_out = Slider(2.9, range=0..10)
depth_of_cut_out = Slider(6, range=0..20)
# Input
radius = Slider(20, range=0..40)
sides = Slider(5, range=0..10)
point = Point(<point referenced from the Rhino model>)

number_slider = Slider(0.25, range=0..1)
# Center cut-out polygon
polygon = Polygon(Plane=point, Radius=width_of_cut_out, Segments=6, FilletRadius=0)  # -> Polygon, Length
# Main polygon - Closed
polygon_2 = Polygon(Plane=point, Radius=radius, Segments=sides, FilletRadius=0)  # -> Polygon, Length
# Deconstruct the polygon into parts
deconstruct_brep = DeconstructBrep(Brep=polygon_2.Polygon)  # -> Faces, Edges, Vertices
length = Length(Curve=deconstruct_brep.Edges)
division = Division(A=width_of_cut_out, B=length)
# Finding the midpoint of the polygon’s edge
curve_middle = CurveMiddle(Curve=deconstruct_brep.Edges)
boolean_toggle = BooleanToggle(True)
# Direction from center to midpoint edge
vector_2pt = Vector2Pt(PointA=point, PointB=curve_middle, Unitize=boolean_toggle)  # -> Vector, Length
# Make the trim areas extend 1mm outside the shape for trim
addition = Addition(A=depth_of_cut_out, B=Toggle(True))
# Set the width of the cut in the edge
scale = Scale(Geometry=deconstruct_brep.Edges, Center=curve_middle, Factor=division)  # -> Geometry, Transform
vector_2pt_2 = Vector2Pt(PointA=curve_middle, PointB=point, Unitize=boolean_toggle)  # -> Vector, Length
# Change length of vector to desired scale factor
amplitude = Amplitude(Vector=vector_2pt_2.Vector, Amplitude=addition)
# Extrude the cut width toward the set direction
extrude = Extrude(Base=scale.Geometry, Direction=amplitude)
# Move the geometry 1 unit outside the polygon in set direction
move = Move(Geometry=extrude, Motion=vector_2pt.Vector)  # -> Geometry, Transform
curve = Curve(polygon.Polygon)

# ----
# Creating 30 pieces
count_on_x_axis = Slider(6, range=0..10)
count_on_y_axis = Slider(5, range=0..10)
corner_radius = Slider(1, range=0..10)
number_slider_2 = Slider(50, range=0..100)

curve_2 = Curve(polygon_2.Polygon)
# Trim
# Trim the middle polygon from the larger main polygon
trim_with_regions = TrimWithRegions(Curve=curve, Regions=curve_2)  # -> Inside, Outside
trim_with_regions_2 = TrimWithRegions(Curve=curve_2, Regions=curve)  # -> Inside, Outside
curve_3 = Curve(flatten(trim_with_regions.Inside))
curve_4 = Curve(flatten(trim_with_regions_2.Outside))
brep = Brep(move.Geometry)

join_curves = JoinCurves(Curves=[curve_4, curve_3], Preserve=False)

# ----
# Trim the rectangles from the polygon
trim_with_regions_3 = TrimWithRegions(Curve=join_curves, Regions=brep)  # -> Inside, Outside
trim_with_regions_4 = TrimWithRegions(Curve=brep, Regions=join_curves)  # -> Inside, Outside
curve_5 = Curve(flatten(trim_with_regions_3.Outside))
curve_6 = Curve(flatten(trim_with_regions_4.Inside))
curve_7 = Curve(trim_with_regions_3.Inside)
curve_8 = Curve(trim_with_regions_4.Outside)
join_curves_2 = JoinCurves(Curves=[curve_6, curve_5], Preserve=False)

# ----
# Arrange the shapes on Rhino canvas
rectangle = Rectangle(Plane=PlaneXY(0, 0, 0), XSize=number_slider_2, YSize=number_slider_2, Radius=0)  # -> Rectangle, Length
rectangular_array = RectangularArray(Geometry=join_curves_2, Cell=rectangle.Rectangle, XCount=count_on_x_axis, YCount=count_on_y_axis)  # -> Geometry, Transform

# ----
# Bake!
# Smoothing out curves
fillet = Fillet(Curve=rectangular_array.Geometry, Radius=corner_radius)
